# Dynamo graph Ejes_estación_01.dyn (Dynamo 2.1.0.7500)

file_path = Filename("D:\EMPRESA\01CR STUDIO\PROYECTOS\ESTACION 01\Coordenadas ejes.xlsx")
string = StringInput("Ejes")
boolean = BoolSelector(true)
code_block = CodeBlock { 0; 1; 2; 3; 4; }
fromExcel = Custom[Grid.FromExcel](path=file_path, sheetName=string, removeHeader=boolean, Point1StartIndex=code_block.out0, Point1EndIndex=code_block.out1, Point2StartIndex=code_block.out2, Point2EndIndex=code_block.out3, MarkIndex=code_block.out4)  # Generates grids from an Excel spreadsheet. Tutorial: https://parametricmonkey.com/2015/06/21/grids-from-excel/
